# Grasshopper definition Wall.gh (Grasshopper 1.0.8)

wall_thickness = Slider(3, range=0..10)
wall_length = Slider(180, range=0..1000)
leg_height = Slider(55, range=0..100)
panel_height = Slider(30, range=0..100)
post_count = Slider(5, range=0..10)
post_width = Slider(10, range=0..10)
pt = Point(Point(0, 0, 0))
num = Number(1)
X = UnitX(Factor=wall_length)
multiplication = Multiplication(A=post_width, B=post_count)
subtraction = Subtraction(A=num, B=post_count)
move = Move(Geometry=pt, Motion=X)  # -> Geometry, Transform
Y = UnitY(Factor=wall_length)
subtraction_2 = Subtraction(A=multiplication, B=wall_length)
ln = Line(StartPoint=pt, EndPoint=move.Geometry)
move_2 = Move(Geometry=move.Geometry, Motion=Y)  # -> Geometry, Transform
division = Division(A=subtraction_2, B=subtraction)
ln_2 = Line(StartPoint=move.Geometry, EndPoint=move_2.Geometry)
merge = Merge(Data1=ln, Data2=ln_2)
merge_2 = Merge(Data1=post_width, Data2=division)
dash = DashPattern(Curve=merge, Pattern=merge_2)  # -> flatten(Dashes), Gaps
merge_3 = Merge(Data1=pt, Data2=move.Geometry, Data3=move_2.Geometry)
join = JoinCurves(Curves=dash.Dashes, Preserve=False)  # -> flatten(Curves)
pline = PolyLine(Vertices=merge_3, Closed=False)
merge_4 = Merge(Data1=join, Data2=graft(pline))
offset = OffsetCurve(Curve=flatten(merge_4), Distance=wall_thickness, Corners=Slider(3, range=0..10))  # -> flatten(Curve)
entwine = Entwine(Branch0X=flatten(merge_4), Branch1X=offset, FlattenInputs=False)
flip = FlipMatrix(Data=entwine)
loft = Loft(Curves=flip, Options={Adjust=False, Closed=False, LoftEnds=0, LoftSimp=0, LoftType=0, Rebuild=10, Refit=0.01})
unflatten = UnflattenTree(Tree=loft, Guide=merge_4)  # -> simplify(Tree)
bang = ExplodeTree(Data=unflatten)  # -> flatten(Branch0), flatten(Branch1)
Z = UnitZ(Factor=leg_height)
move_3 = Move(Geometry=bang.Branch1, Motion=Z)  # -> Geometry, Transform
extr = Extrude(Base=bang.Branch0, Direction=Z)
Z_2 = UnitZ(Factor=panel_height)
extr_2 = Extrude(Base=move_3.Geometry, Direction=Z_2)
sunion = SolidUnion(Breps=[extr, extr_2])
